# Dynamo graph CD_01.dyn (Dynamo 2.3.0.5885)

mandate = CodeBlock { 71; }
mandate_2 = CodeBlock { 40; }
koalition = CodeBlock(k1=mandate, k2=mandate_2) { k1+k2; }
mandate_3 = CodeBlock { 30; }
mandate_4 = CodeBlock { 26; }
mandate_5 = CodeBlock { 15; }
mandate_6 = CodeBlock { 1; }
opposition = CodeBlock(o1=mandate_3, o2=mandate_4, o3=mandate_5, o4=mandate_6) { o1+o2+o3+o4; }
gesamtmandate = CodeBlock(p1=mandate, p2=mandate_2, p3=mandate_3, p4=mandate_4, p5=mandate_5, p6=mandate_6) { p1+p2+p3+p4+p5+p6; }
zweidrittelmehrheit = CodeBlock(gm=gesamtmandate) { Math.Round((gm/3)*2); }
einfache_mehrheit = CodeBlock(gm=gesamtmandate) { Math.Round(gm/2); }
parteiname = CodeBlock { "OEVP"; }
parteiname_2 = CodeBlock { "SPOE"; }
parteiname_3 = CodeBlock { "FPOE"; }
parteiname_4 = CodeBlock { "GRUENE"; }
parteiname_5 = CodeBlock { "NEOS"; }
parteiname_6 = CodeBlock { "OK"; }
parteien_im_nationalrat = List.Create(item0=parteiname, item1=parteiname_2, item2=parteiname_3, item3=parteiname_4, item4=parteiname_5, item5=parteiname_6)
