# Dynamo graph DD_01.dyn (Dynamo 2.3.0.5885)

mandates = CodeBlock { 71; }
mandates_2 = CodeBlock { 40; }
coalition = CodeBlock(k1=mandates, k2=mandates_2) { k1+k2; }
mandates_3 = CodeBlock { 30; }
mandates_4 = CodeBlock { 26; }
mandates_5 = CodeBlock { 15; }
mandates_6 = CodeBlock { 1; }
opposition = CodeBlock(o1=mandates_3, o2=mandates_4, o3=mandates_5, o4=mandates_6) { o1+o2+o3+o4; }
overall_mandates = CodeBlock(p1=mandates, p2=mandates_2, p3=mandates_3, p4=mandates_4, p5=mandates_5, p6=mandates_6) { p1+p2+p3+p4+p5+p6; }
bare_majority = CodeBlock(gm=overall_mandates) { Math.Round(gm/2); }
party_name = CodeBlock { "OEVP"; }
party_name_2 = CodeBlock { "SPOE"; }
party_name_3 = CodeBlock { "FPOE"; }
party_name_4 = CodeBlock { "GRUENE"; }
party_name_5 = CodeBlock { "NEOS"; }
party_name_6 = CodeBlock { "OK"; }
national_assembly = List.Create(item0=party_name, item1=party_name_2, item2=party_name_3, item3=party_name_4, item4=party_name_5, item5=party_name_6)
two_thirds = CodeBlock(gm=overall_mandates) { Math.Round((gm/3)*2); }
blocking_minority = CodeBlock(GM=overall_mandates, ZDM=two_thirds) { GM-ZDM+1; }
