# Dynamo graph DD_02.dyn (Dynamo 2.3.0.5885)

# group: Wahlzahl
code_block = CodeBlock {  }

stimmen_i_regionalwahlkreis = CodeBlock { 55000; }  # "Stimmen i. Regionalwahlkreis Partei A"
gueltige_stimmen_i = CodeBlock { 600333; }  # "Gueltige Stimmen i. Landeswahlkreis"
mandate_d_landes = CodeBlock { 11; }
wahlzahl = CodeBlock(GueltigeStimmen=gueltige_stimmen_i, Mandate=mandate_d_landes) { "Wahlkreis 1"; GueltigeStimmen; Mandate; }
wahlzahl_2 = CodeBlock(i1=wahlzahl.GueltigeStimmen, i2=wahlzahl.Mandate) { Math.Round(i1/i2); }
mandate_regionalwahlkreis = CodeBlock(i2=stimmen_i_regionalwahlkreis, i1=wahlzahl_2) { Math.Floor(i2/i1); }
stimmen_i_regionalwahlkreis_2 = CodeBlock { 7000; }  # "Stimmen i. Regionalwahlkreis Partei B"
mandate_regionalwahlkreis_2 = CodeBlock(i2=stimmen_i_regionalwahlkreis_2, i1=stimmen_i_regionalwahlkreis) { Math.Floor(i2/i1); }
